# Grasshopper definition extruder_control.ghx (Grasshopper 1.0.7)

# Settings
ext_ip = ValueList({"192.168.10.10", "192.168.10.20", "192.168.10.11", "192.168.10.12", "127.0.0.1", "192.168.10.111", "192.168.0.220", "192.168.0.30", "192.168.10.50", "0.0.0.0"}, selected="192.168.0.220")
ext_port = ValueList({"50003", "50004"}, selected="50004")

# ----
# Check if Extruder controller
#  is available
ping = Button()
py = PythonScript(ip=ext_ip, ping=ping)  # -> out, trigger
# ---------- py: Python ----------
import os
from scriptcontext import sticky as st

guid = str(ghenv.Component.InstanceGuid)
txt_key = "txt_" + guid
if txt_key not in st:
    st[txt_key] = ""

def is_available(ip):
    syscall = "ping -r 1 -n 1 %s"
    response = os.system(syscall % ip)
    if response == 0:
        return True
    else:
        return False

if ping:
    available = is_available(ip)
    
    if available:
        st[txt_key] = "%s is up!" % ip
        trigger = True
    else:
        st[txt_key] = "%s is down!" % ip
        trigger = False

print(st[txt_key])
# ---------- end py ----------
panel = Panel(py.out)

# ----
# --> Set controller IP address
button = Button()
globals = PythonScript(ext_ip=ext_ip, ext_port=ext_port, clear=button)
# ---------- globals: Python ----------
from scriptcontext import sticky as st

st["server_address"] = server_address
st["server_port"] = server_port

st["ur_ip"] = ur_ip
st["ur_port"] = ur_port

st["ext_ip"] = ext_ip
st["ext_port"] = ext_port


if clear:
    st.clear()
# ---------- end globals ----------

# ----
# Set Motor Data
# Motor will accellerate up to max_speed, speed value must be set as a start value for the motor to initiate.
# 
# Speed value cannot be higher than the max_speed value, and should not be set too high as the motor will block.
# 
# Speed values include microsteps, thus a value of 10 with no microstepping will result in the same speed as the value 160 with 16x microsteps.
speed = Slider(12000, range=0..51200)
max_speed = Slider(17000, range=0..51200)
value = BooleanToggle(True)
send = Button()
extruder_data = PythonScript(motor_state=value, max_speed=max_speed, speed=speed, send=send)  # -> urscript; inputs motor_state: Boolean
# ---------- extruder_data: Python ----------
import time
from scriptcontext import sticky as st
from extruder_control.extruderclient import ExtruderClient

ext_ip = st["ext_ip"]
ext_port = st["ext_port"]

ec = ExtruderClient(ext_ip, ext_port)
wait_for_response = False

if send:
    ec.connect()
    time.sleep(0.2)
    ec.send_motordata(motor_state, max_speed, speed, wait_for_response)
    time.sleep(0.2)
    ec.close()
# ---------- end extruder_data ----------

# ----
# Direct extruder control
# Toggle Digital Output
value_2 = BooleanToggle(True)
send_2 = Button()
list = ValueList({"1", "2", "3", "4", "5", "6", "7", "8", "9", "10", "11", "12", "13"}, selected="1")
digital_out = PythonScript(pin=list, state=value_2, send=send_2)  # -> urscript; inputs pin: Int32, state: Boolean
# ---------- digital_out: Python ----------
import time
from scriptcontext import sticky as st
from extruder_control.extruderclient import ExtruderClient

ext_ip = st["ext_ip"]
ext_port = st["ext_port"]

ec = ExtruderClient(ext_ip, ext_port)
wait_for_response = False

if send:
    ec.connect()
    time.sleep(0.2)
    ec.send_set_do(pin, int(state), wait_for_response)
    time.sleep(0.2)
    ec.close()
# ---------- end digital_out ----------

# ----
# Stop ALL
stop = Button()
stop_2 = PythonScript(stop=stop)
# ---------- stop_2: Python ----------
import time
from scriptcontext import sticky as st
from extruder_control.extruderclient import ExtruderClient

ext_ip = st["ext_ip"]
ext_port = st["ext_port"]

ec = ExtruderClient(ext_ip, ext_port)
wait_for_response = False

if stop:
    ec.connect()
    time.sleep(0.2)
    ec.send_stop(wait_for_response)
    time.sleep(0.2)
    ec.close()
# ---------- end stop_2 ----------

# ----
# Toggle Motor State
value_3 = BooleanToggle(True)
send_3 = Button()
extruder_state = PythonScript(state=value_3, send=send_3)  # -> urscript; inputs state: Boolean
# ---------- extruder_state: Python ----------
import time
from scriptcontext import sticky as st
from extruder_control.extruderclient import ExtruderClient

ext_ip = st["ext_ip"]
ext_port = st["ext_port"]

ec = ExtruderClient(ext_ip, ext_port)
wait_for_response = False

if send:
    ec.connect()
    time.sleep(0.2)
    ec.send_motorstate(int(state), wait_for_response)
    time.sleep(0.2)
    ec.close()
# ---------- end extruder_state ----------
