# Grasshopper definition extruder_pump_control.ghx (Grasshopper 1.0.7)

# Concrete Extruder
ext_ip = ValueList({"192.168.125.220", "192.168.125.60"}, selected="192.168.125.220")
# Concrete Pump
ext_ip_2 = ValueList({"192.168.125.10"}, selected="192.168.125.10")
ext_port = ValueList({"50003", "50004"}, selected="50004")
ext_port_2 = ValueList({"50003", "50004", "50001"}, selected="50004")

# ----
# --> Set controller IP address
button = Button()
globals = PythonScript(ext_ip=ext_ip_2, ext_port=ext_port, clear=button)
# ---------- globals: Python ----------
from scriptcontext import sticky as st

#st["server_address"] = server_address
#st["server_port"] = server_port

st["ext_ip"] = ext_ip
st["ext_port"] = ext_port


if clear:
    st.clear()
# ---------- end globals ----------

# ----
# --> Set controller IP address
button_2 = Button()
globals_2 = PythonScript(ext_ip=ext_ip, ext_port=ext_port_2, clear=button_2)  # same code as globals

ping = Button()
py = PythonScript(ip=ext_ip, ping=ping)  # -> out, trigger
# ---------- py: Python ----------
import os
from scriptcontext import sticky as st

guid = str(ghenv.Component.InstanceGuid)
txt_key = "txt_" + guid
if txt_key not in st:
    st[txt_key] = ""

def is_available(ip):
    syscall = "ping -r 1 -n 1 %s"
    response = os.system(syscall % ip)
    if response == 0:
        return True
    else:
        return False

if ping:
    available = is_available(ip)
    
    if available:
        st[txt_key] = "%s is up!" % ip
        trigger = True
    else:
        st[txt_key] = "%s is down!" % ip
        trigger = False

print(st[txt_key])
# ---------- end py ----------
panel = Panel(py.out)

ping_2 = Button()
py_2 = PythonScript(ip=ext_ip_2, ping=ping_2)  # -> out, trigger; same code as py
panel_2 = Panel(py_2.out)

# ----
# Set Motor Data
speed = Slider(20000, range=0..51200)
max_speed = Slider(51200, range=0..51200)
send = Button()
value = BooleanToggle(True)
extruder_data = PythonScript(motor_state=value, max_speed=max_speed, speed=speed, send=send)  # -> out; inputs motor_state: Boolean
# ---------- extruder_data: Python ----------
import time
from scriptcontext import sticky as st
from extruder_control.extruderclient import ExtruderClient

ext_ip = st["ext_ip"]
ext_port = st["ext_port"]

ec = ExtruderClient(ext_ip, ext_port)
wait_for_response = False

if send:
    ec.connect()
    time.sleep(0.2)
    ec.send_motordata(motor_state, max_speed, speed, wait_for_response)
    #ec.get_msg_arduino_info(wait_for_response)
    time.sleep(0.2)
    ec.close()
# ---------- end extruder_data ----------

# ----
# extruder control
# Toggle Digital Output
value_2 = BooleanToggle(True)
send_2 = Button()
list = ValueList({"1", "2", "3", "4", "5", "6", "7", "8", "9", "10", "11", "12", "13"}, selected="10")
digital_out = PythonScript(pin=list, state=value_2, send=send_2)  # -> out; inputs pin: Int32, state: Boolean
# ---------- digital_out: Python ----------
import time
from scriptcontext import sticky as st
from extruder_control.extruderclient import ExtruderClient

ext_ip = st["ext_ip"]
ext_port = st["ext_port"]

ec = ExtruderClient(ext_ip, ext_port)
wait_for_response = False

if send:
    ec.connect()
    time.sleep(0.2)
    ec.send_set_do(pin, int(state), wait_for_response)
    time.sleep(0.2)
    ec.close()
# ---------- end digital_out ----------

data_recorder = DataRecorder(digital_out, DataLimit=-10, RecordData=True)
data_recorder_2 = DataRecorder(extruder_data, DataLimit=-10, RecordData=True)
out = Panel(data_recorder)
out_2 = Panel(data_recorder_2)

# ----
# Toggle Motor State
value_3 = BooleanToggle(True)
send_3 = Button()
extruder_state = PythonScript(state=value_3, send=send_3)  # -> out; inputs state: Boolean
# ---------- extruder_state: Python ----------
import time
from scriptcontext import sticky as st
from extruder_control.extruderclient import ExtruderClient

ext_ip = st["ext_ip"]
ext_port = st["ext_port"]

ec = ExtruderClient(ext_ip, ext_port)
wait_for_response = False

if send:
    ec.connect()
    time.sleep(0.2)
    ec.send_motorstate(int(state), wait_for_response)
    time.sleep(0.2)
    ec.close()
# ---------- end extruder_state ----------

# ----
# Stop ALL
stop = Button()
stop_2 = PythonScript(stop=stop)  # -> out
# ---------- stop_2: Python ----------
import time
from scriptcontext import sticky as st
from extruder_control.extruderclient import ExtruderClient

ext_ip = st["ext_ip"]
ext_port = st["ext_port"]

ec = ExtruderClient(ext_ip, ext_port)
wait_for_response = False

if stop:
    ec.connect()
    time.sleep(0.2)
    ec.send_stop(wait_for_response)
    time.sleep(0.2)
    ec.close()
# ---------- end stop_2 ----------

data_recorder_3 = DataRecorder(extruder_state, DataLimit=-10, RecordData=True)
out_3 = Panel(data_recorder_3)
data_recorder_4 = DataRecorder(stop_2, DataLimit=-10, RecordData=True)
out_4 = Panel(data_recorder_4)
